# Dynamo graph 09-ISOLATED FOUNDATION EXCAVATION.dyn (Dynamo 0.9.1.4062)

string = StringInput("OST_StructuralFoundation")  # frozen
byName = Category.ByName(string)
all_elements_of_category = ElementsOfCategory(byName)
select_model_elements = DSModelElementsSelection()  # 97 picked in the model
category_name = StringInput("Structural Foundations")
filter_foundations = Python(IN[0]=select_model_elements, IN[1]=category_name)
# ---------- filter_foundations.python (17 lines) ----------
import clr
clr.AddReference('ProtoGeometry')
from Autodesk.DesignScript.Geometry import *
#The inputs to this node will be stored as a list in the IN variables.
dataEnteringNode = IN
elems = IN[0]
cateName = IN[1]

res = []

for e in elems:
	ee = UnwrapElement(e)
	if ee.Category.Name == cateName:
		res.append(e)

#Assign your output to the OUT variable.
OUT = res
# ----------------------------------------
code_block = CodeBlock(elems=filter_foundations) { elems; }
code_block_2 = CodeBlock { "Elevation at Top"; "Elevation at Bottom"; "Width"; "Length"; }
level_of_nature_ground_soil = Levels("Exc LV")  # "Level of Nature Ground Soil Surface"
elevation = Level.Elevation(level_of_nature_ground_soil)

# group: foundation parameter value
getParameterValueByName = Element.GetParameterValueByName(element=code_block)
getParameterValueByName_2 = Element.GetParameterValueByName(element=code_block)
sub = elevation - getParameterValueByName_2
getParameterValueByName_3 = Element.GetParameterValueByName(element=code_block)
getParameterValueByName_4 = Element.GetParameterValueByName(element=code_block)
id = Element.Id(code_block)

facingOrientation = FamilyInstance.FacingOrientation(code_block)  # frozen
XAxis = Vector.XAxis()
angleBetween = Vector.AngleBetween(facingOrientation, XAxis)

# group: Radian to Degree
number = DoubleInput(57.296)
mul = angleBetween * number

watch = Watch(mul)
excavate_hole_family_type_name = StringInput("Excavate Hole-Taluy")
byName_2 = FamilyType.ByName(excavate_hole_family_type_name)
location = FamilyInstance.Location(code_block)
X = Point.X(location)
Y = Point.Y(location)
byCoordinates = Point.ByCoordinates(x=X, y=Y, z=elevation)
byPoint = FamilyInstance.ByPoint(familyType=byName_2, point=byCoordinates)
code_block_3 = CodeBlock(elems=byPoint) { elems; }
code_block_4 = CodeBlock()
# ---------- code_block_4.designscript (14 lines) ----------
"Height";
"Width";
"Length";
"Comments";
"HostID1";
"TrackingHostID1";
"ExcavationTaluyAngleToX";
"VolumeExcavatedSoilPrimitive";
"VolumeExcavatedSoilMerged";
"VolumeBackfillSoil";
"AreaBOFImpactmentPrimitive";
"AreaBOFImpactmentMerged";
"AreaTOESImpactmentPrimitive";
"AreaTOESImpactmentMerged";
# ----------------------------------------
setParameterByName = Element.SetParameterByName(element=code_block_3, parameterName=code_block_4.out0)
setParameterByName_2 = Element.SetParameterByName(element=setParameterByName, parameterName=code_block_4.out1)
setParameterByName_3 = Element.SetParameterByName(element=setParameterByName_2, parameterName=code_block_4.out2)
setRotation = FamilyInstance.SetRotation(familyInstance=code_block_3)
python_script_rotation = Python(IN[0]=code_block)
# ---------- python_script_rotation.python (19 lines) ----------
import clr
clr.AddReference('ProtoGeometry')
from Autodesk.DesignScript.Geometry import *
clr.AddReference('RevitAPI')
from Autodesk.Revit.DB import *
#The inputs to this node will be stored as a list in the IN variables.
dataEnteringNode = IN

elems = UnwrapElement(IN[0])
results = []
#if listcount = 1

#if listcount > 1
for i in range(len(elems)):
	rot = round(elems[i].Location.Rotation * 57.2957795,0)
	results.append(rot)

#Assign your output to the OUT variable.
OUT = results
# ----------------------------------------
code_block_5 = CodeBlock(a=python_script_rotation) { 0-a; }
code_block_6 = CodeBlock(list=setParameterByName) { list[0]; }
parameters = Element.Parameters(code_block_6)
watch_2 = Watch(parameters)
code_block_7 = CodeBlock(list=code_block) { list[0]; }
parameters_2 = Element.Parameters(code_block_7)
watch_3 = Watch(parameters_2)
setParameterByName_4 = Element.SetParameterByName(element=setParameterByName_2, parameterName=code_block_4.out3)
setParameterByName_5 = Element.SetParameterByName(element=setParameterByName_4, parameterName=code_block_4.out4)
setParameterByName_6 = Element.SetParameterByName(element=setParameterByName_5, parameterName=code_block_4.out5)

# group: Calulate Volume
code_block_8 = CodeBlock(elemCalVolume=setParameterByName_6) { elemCalVolume; }
element_setparameterbyname = Element.SetParameterByName(element=code_block_8, parameterName=code_block_4.out7)  # "Element.SetParameterByName-v3ExcSoilPrimi"
solids = Element.Solids(code_block_8)
python_script_unionall = Python(IN[0]=solids)
# ---------- python_script_unionall.python (16 lines) ----------
import clr
clr.AddReference('ProtoGeometry')
from Autodesk.DesignScript.Geometry import *
#The inputs to this node will be stored as a list in the IN variables.
dataEnteringNode = IN
listSol = IN[0]

newlist = []
for list in listSol:
	
	sol = list[0]
	union = sol.UnionAll(list)
	newlist.append(union)
		
#Assign your output to the OUT variable.
OUT = newlist
# ----------------------------------------
volume = Solid.Volume(python_script_unionall)
code_block_9 = CodeBlock { 1000000000; }
div = volume / code_block_9
output = CodeBlock(excMergedSolids=python_script_unionall) { excMergedSolids; }

solids_2 = Element.Solids(code_block)
python_script_unionall_2 = Python(IN[0]=solids_2)  # same code as python_script_unionall
string_2 = StringInput("Foundation Excavation")
