# Dynamo graph 34-UNDERGROUND STRUC FOR EXCAVATION embank-CATE BY CATE.dyn (Dynamo 0.9.1.4062)

select_model_elements = DSModelElementsSelection()  # 1049 picked in the model
category_name = StringInput("Structural Foundations")
category_name_2 = StringInput("Walls")
category_name_3 = StringInput("Structural Columns")
category_name_4 = StringInput("Structural Framing")
category_name_5 = StringInput("Floors")
python_script = Python(IN[0]=select_model_elements, IN[1]=category_name, IN[2]=category_name_2, IN[3]=category_name_3, IN[4]=category_name_4, IN[5]=category_name_5)
# ---------- python_script.python (22 lines) ----------
import clr
clr.AddReference('ProtoGeometry')
from Autodesk.DesignScript.Geometry import *
#The inputs to this node will be stored as a list in the IN variables.
dataEnteringNode = IN
elems = IN[0]
cateName1 = IN[1]
cateName2 = IN[2]
cateName3 = IN[3]
cateName4 = IN[4]
cateName5 = IN[5]

res = []

for e in elems:
	ee = UnwrapElement(e)
	cat = ee.Category.Name
	if cat == cateName1 or cat == cateName2 or cat == cateName3 or cat == cateName4 or cat == cateName5:
		res.append(e)

#Assign your output to the OUT variable.
OUT = res
# ----------------------------------------
code_block = CodeBlock(elems=python_script) { elems; }
solids = Element.Solids(code_block)
flatten = Flatten(solids)
isNull = Object.IsNull(flatten)
filterByBoolMask = List.FilterByBoolMask(list=flatten, mask=isNull)
flatten_2 = Flatten(filterByBoolMask.out)
deconstruct = List.Deconstruct(list=flatten_2)  # frozen
unionAll = Solid.UnionAll(deconstruct.first, deconstruct.rest)
code_block_2 = CodeBlock(solids=unionAll) { solids; }
directory_path = Directory("C:\Users\tvpduy\Desktop")
string_from_object = FromObject(directory_path)
string = StringInput("\")
file_name = StringInput("UG Struc for Embank")
code_block_3 = CodeBlock(name=file_name) { name; }
volume = Solid.Volume(flatten_2)
number = DoubleInput(1000000000)
div = volume / number
sum = Math.Sum(div)
number_2 = DoubleInput(3)
round = Math.Round(number=sum, digits=number_2)
code_block_4 = CodeBlock(dir=string_from_object, plash=string, filename=code_block_3, Info=round) { filepath = dir+plash+filename+"-"+Info+" m3"+".sat"; }
exportToSAT = ExportWithUnits(code_block_2, code_block_4, exportedUnit=Millimeters)
create = List.Create(flatten_2)
code_block_5 = CodeBlock(cat=category_name_4) { cat; }
revit_category_filterer_1 = Custom[Revit Category Filterer 1](select_model_elements, code_block_5)  # frozen
code_block_6 = CodeBlock(sf=file_name, cat=code_block_5) { name = sf + "-"+cat; }
filterByBoolMask_2 = List.FilterByBoolMask(list=code_block, mask=isNull)  # frozen
python_script_find_error_element = Python(IN[0]=filterByBoolMask_2.in)  # starter script, not edited (OUT = 0)
select_model_element = DSModelElementSelection()  # 1 picked in the model
solids_2 = Element.Solids(select_model_element)
flatten_3 = Flatten(solids_2)
difference = Solid.Difference(solid=code_block_2, other=flatten_3)  # frozen
