# Dynamo graph 39- WALL STIFFERNER.dyn (Dynamo 0.9.1.4062)

select_model_elements = DSModelElementsSelection()  # 36 picked in the model
filter = CodeBlock { "Walls"; }
revit_category_filterer_1 = Custom[Revit Category Filterer 1](select_model_elements, filter)
code_block = CodeBlock { "Type"; "Width"; }
code_block_2 = CodeBlock(t2=revit_category_filterer_1, str1=code_block.out0, str2=code_block.out1) { t1 = t2.GetParameterValueByName(str1); t3 = t1.GetParameterValueByName(str2); }
parameters = Element.Parameters(code_block_2.t1)
string = StringInput("Stifferner")
byName = FamilyType.ByName(string)
python_script_get_wall_curve = Python(IN[0]=revit_category_filterer_1)
# ---------- python_script_get_wall_curve.python (39 lines) ----------
import clr
clr.AddReference('ProtoGeometry')
from Autodesk.DesignScript.Geometry import *
clr.AddReference('RevitAPI')
from Autodesk.Revit.DB import *
clr.AddReference('RevitAPIUI')
from Autodesk.Revit.UI import TaskDialog
clr.AddReference("RevitNodes")
import Revit
clr.ImportExtensions(Revit.Elements)
clr.AddReference("RevitServices")
import RevitServices
from RevitServices.Persistence import DocumentManager
from RevitServices.Transactions import TransactionManager
from System.Collections.Generic import *
clr.ImportExtensions(Revit.GeometryConversion)
 
 
 
doc = DocumentManager.Instance.CurrentDBDocument
uiapp = DocumentManager.Instance.CurrentUIApplication
app = uiapp.Application

#The inputs to this node will be stored as a list in the IN variables.
dataEnteringNode = IN
walls = UnwrapElement(IN[0])

res = []

opt = Options()

for w in walls:	
	loc = w.Location
	c = loc.Curve
	res.append(c.ToProtoType())


#Assign your output to the OUT variable.
OUT = res
# ----------------------------------------
python_script_intersect_point = Python(IN[0]=python_script_get_wall_curve)
# ---------- python_script_intersect_point.python (29 lines) ----------
import clr
clr.AddReference('ProtoGeometry')
from Autodesk.DesignScript.Geometry import *

 
 

#The inputs to this node will be stored as a list in the IN variables.
dataEnteringNode = IN
curves = IN[0]

def getIntersectPoints(curves):
	res = []	
	still = True
	i = 1
	while i < len(curves):
		c0 = curves[i-1]		
		rest = curves[i:]		
		for c in rest:
			flag = c0.DoesIntersect(c)
			if flag:
				p = c0.Intersect(c)
				res.append(p)
		i+=1
	return res

res = getIntersectPoints(curves)
#Assign your output to the OUT variable.
OUT = res
# ----------------------------------------
flatten = Flatten(python_script_intersect_point)
levels = Levels("Level 1")
byPointAndLevel = FamilyInstance.ByPointAndLevel(familyType=byName, point=flatten, level=levels)
code_block_3 = CodeBlock { "W"; "L"; "H"; }
code_block_4 = CodeBlock { 200; 3000; }
setParameterByName = Element.SetParameterByName(element=byPointAndLevel, parameterName=code_block_3.out0, value=code_block_4.out0)
setParameterByName_2 = Element.SetParameterByName(element=byPointAndLevel, parameterName=code_block_3.out1, value=code_block_4.out0)
setParameterByName_3 = Element.SetParameterByName(element=byPointAndLevel, parameterName=code_block_3.out2, value=code_block_4.out1)
free_ends_at_wall = BoolSelector(true)
