# Dynamo custom node Revit Category Filterer 1.dyf (Dynamo 0.9.1.4062)
# category: Revit.Selection

Input = Input()
Input_2 = Input()
python_script_filterer = Python(IN[0]=Input, IN[1]=Input_2)
# ---------- python_script_filterer.python (17 lines) ----------
import clr
clr.AddReference('ProtoGeometry')
from Autodesk.DesignScript.Geometry import *
#The inputs to this node will be stored as a list in the IN variables.
dataEnteringNode = IN
elems = IN[0]
cateName = IN[1]

res = []

for e in elems:
	ee = UnwrapElement(e)
	if ee.Category.Name == cateName:
		res.append(e)

#Assign your output to the OUT variable.
OUT = res
# ----------------------------------------
Output = Output(python_script_filterer)  # ""
