# Dynamo graph _Geometry 1.dyn (Dynamo 0.9.1.4062)

code_block = CodeBlock { 0; 5000; }
byCoordinates = Point.ByCoordinates(x=code_block.out0, y=code_block.out0)
byOrigin = CoordinateSystem.ByOrigin(x=code_block.out0, y=code_block.out0)
byWidthLength = Rectangle.ByWidthLength(cs=byOrigin, width=code_block.out1, length=code_block.out1)
explode = Geometry.Explode(byWidthLength)
startPoint = Curve.StartPoint(explode)
byPerimeterPoints = Surface.ByPerimeterPoints(startPoint)
ZAxis = Vector.ZAxis()
translate = Geometry.Translate(geometry=byWidthLength, direction=ZAxis, distance=code_block.out1)
explode_2 = Geometry.Explode(translate)
startPoint_2 = Curve.StartPoint(explode_2)
code_block_2 = CodeBlock(points=startPoint_2) { points; }
code_block_3 = CodeBlock(p=startPoint_2) { i1 = 1; i3 = 3; p1 = p[i1]; p3 = p[i3]; }
code_block_4 = CodeBlock { -500; -2000; }
translate_2 = Geometry.Translate(geometry=code_block_3.p1, direction=ZAxis, distance=code_block_4.out0)
replaceItemAtIndex = List.ReplaceItemAtIndex(list=code_block_2, index=code_block_3.i1, item=translate_2)
translate_3 = Geometry.Translate(geometry=code_block_3.p3, direction=ZAxis, distance=code_block_4.out1)
replaceItemAtIndex_2 = List.ReplaceItemAtIndex(list=replaceItemAtIndex, index=code_block_3.i3, item=translate_3)
code_block_5 = CodeBlock(newStartPoints=replaceItemAtIndex_2) { newStartPoints; }
byPerimeterPoints_2 = Surface.ByPerimeterPoints(code_block_5)
code_block_6 = CodeBlock(topSurface=byPerimeterPoints, bottomSurface=byPerimeterPoints_2) { topSurface; bottomSurface; }
XAxis = Vector.XAxis()
code_block_7 = CodeBlock { 5000; }
translate_4 = Geometry.Translate(geometry=code_block_6.topSurface, direction=XAxis, distance=code_block_7)
create = List.Create(code_block_6.topSurface, translate_4)
translate_5 = Geometry.Translate(geometry=code_block_6.bottomSurface, direction=XAxis, distance=code_block_7)
create_2 = List.Create(code_block_6.bottomSurface, translate_5)
solid_by_merged_surfaces_1 = Custom[Solid By Merged Surfaces 1](topSurface=create, bottomSurface=create_2)
